# Dynamo graph listas_desde_txt.dyn (Dynamo 2.0.2.6826)

python_script = Python()  # unwired: IN[0]
# ---------- python_script.python (10 lines) ----------
# Activar la compatibilidad con Python y cargar biblioteca de DesignScript
import clr
clr.AddReference('ProtoGeometry')
from Autodesk.DesignScript.Geometry import *


ciudad=[]
for linea in open("./lista.txt"):
	ciudad.append(linea + " - central")
OUT = [ciudad]
# ----------------------------------------
watch = Watch(python_script)
