# Dynamo graph 1.dyn (Dynamo 2.0.2.6826)

python_script = Python()  # unwired: IN[0]
# ---------- python_script.python (17 lines) ----------
# Activar la compatibilidad con Python y cargar biblioteca de DesignScript
import clr
clr.AddReference('ProtoGeometry')
from Autodesk.DesignScript.Geometry import *

# Las entradas de este nodo se almacenan como lista en las variables IN.
class Persona():

		
    def __init__(self, nombre, nacionalidad):
    	self.nombre=nombre
    	self.nacionalidad=nacionalidad
    edad = 18	# aqui edad es una variable de clase y nombre es variable de instancia
    			# las variables de clase solo me deja declarar debajo de los metodos en Py script
p1=Persona("pedro", "paraguay") 
 
OUT = [p1.nombre,Persona.edad]
# ----------------------------------------
