# Dynamo graph 2.dyn (Dynamo 2.0.2.6826)

python_script = Python()  # unwired: IN[0]
# ---------- python_script.python (19 lines) ----------
# Activar la compatibilidad con Python y cargar biblioteca de DesignScript
import clr
clr.AddReference('ProtoGeometry')
from Autodesk.DesignScript.Geometry import *

class Persona():
	def __init__(self,nombre,ciudad):
		self.nombre=nombre
		self.ciudad=ciudad
		
	def nadar(self): #no olvidar el self en metodos de instancia
		return "estoy nadando"
	edad=18

p1= Persona("jose","Asuncion")
p2=p1.nadar()

#en un metodo de instancia debemos apoyarmos en un objeto ya creado
OUT = [p2,Persona.edad]
# ----------------------------------------
