# Dynamo graph 5_metodos_estaticos.dyn (Dynamo 2.0.2.6826)

python_script = Python()  # unwired: IN[0]
# ---------- python_script.python (28 lines) ----------
# Activar la compatibilidad con Python y cargar biblioteca de DesignScript
import clr
clr.AddReference('ProtoGeometry')
from Autodesk.DesignScript.Geometry import *

class Persona():
	def __init__(self):
		pass #para pasar sin colocar nada en el init
		
	
	def despedir(self): #metodo de instancia
		return "Adiós"
		
		
	@classmethod # @classmethod es un decorador para un metodo de clase, siempre debe llevar esto un metodo de clase
	def saludar(cls, nombre):  # en metodos de clase lleva el cls
		return "Estoy saludando a " + nombre
		
		
		
saludo = Persona.saludar("Jose") #llamando a un metodo de clase


miguel = Persona()  
despedida = miguel.despedir() #llamando a un metodo de instancia

#en un metodo de instancia debemos apoyarmos en un objeto ya creado
OUT = [saludo, despedida]
# ----------------------------------------
