# Dynamo graph 6_metodos_especiales_en_python.dyn (Dynamo 2.0.2.6826)

python_script = Python()  # unwired: IN[0]
# ---------- python_script.python (27 lines) ----------
# Activar la compatibilidad con Python y cargar biblioteca de DesignScript
import clr
clr.AddReference('ProtoGeometry')
from Autodesk.DesignScript.Geometry import *

class Persona():
	def __init__(self):
		pass #para pasar sin colocar nada en el init
		
	
	def despedir(self): #metodo de instancia
		return "Adiós"
		
		
	@classmethod # @classmethod es un decorador para un metodo de clase, siempre debe llevar esto un metodo de clase
	def saludar(cls, nombre):  # cls equivale al  "static" de otros lenguajes
		return "Estoy saludando a " + nombre
	
	@staticmethod # otro decorador en lugar de usar cls
	def jugar():
		return "Estoy Jugando"

miguel = Persona()  
despedida = miguel.despedir() #llamando a un metodo de instancia

#en un metodo de instancia debemos apoyarmos en un objeto ya creado
OUT = [despedida, Persona.jugar(),Persona.saludar("miguel"),miguel.saludar("pedro")]
# ----------------------------------------
