# Dynamo graph 8_polimorfismo_en_python.dyn (Dynamo 2.0.2.6826)

python_script = Python()  # unwired: IN[0]
# ---------- python_script.python (15 lines) ----------
# Activar la compatibilidad con Python y cargar biblioteca de DesignScript
import clr
clr.AddReference('ProtoGeometry')
from Autodesk.DesignScript.Geometry import *
#los metodos especiales son los que tienen dos guiones bajos como el init
class Circulo():
	
	def __init__(self,radio):
		self.radio=radio	
	@property	#decorador para propiedad
	def area(self):
		return 3.141592*(self.radio**2)	#area es una propiedad del circulo
c= Circulo(3)
 
OUT =[c.area] #accedemos al area como propiedad y no como metodo
# ----------------------------------------
