# Dynamo graph 9_instrospeccion_de_objetos_en_python.dyn (Dynamo 2.0.2.6826)

python_script = Python()  # unwired: IN[0]
# ---------- python_script.python (20 lines) ----------
# Activar la compatibilidad con Python y cargar biblioteca de DesignScript
import clr
clr.AddReference('ProtoGeometry')
from Autodesk.DesignScript.Geometry import *
#los metodos especiales son los que tienen dos guiones bajos como el init
class Introspeccion():

	def __init__(self,valor):
		self.valor=valor
	def dos(self):
		return "dos=2"
	def tres(self):
		return "tres=3"
	introver=9
dato = Introspeccion("valor")
	
lo_que_tengo = dir(dato) #para saber mas de la clase intro, todas las instancias
bool1=isinstance(dato,Introspeccion)#preguntamos si una variable (dato) es instancia de una clase, en este caso true
bool2=hasattr(dato,"introver") # preguntamos si la instancia dato posee el atributo introver
OUT = [lo_que_tengo,bool1, bool2 ]
# ----------------------------------------
