# Dynamo graph crear_hilos.dyn (Dynamo 2.0.2.6826)

python_script = Python()  # unwired: IN[0]
# ---------- python_script.python (20 lines) ----------
# Activar la compatibilidad con Python y cargar biblioteca de DesignScript
import clr
clr.AddReference('ProtoGeometry')
from Autodesk.DesignScript.Geometry import *
import threading #hilos
import time

class MiHilo(threading.Thread):
	def run(self):  #run ya viene con hilos
		return "{} inicio".format(self.getName())
		time.sleep(1)
		return "{} terminado".format(self.getName()) 

if __name__=="__main__":
	for x in range(4):
		hilo=MiHilo(name="Thread-{}".format(x+1))
		hilo.start()
		time.sleep(0.5)

OUT = MiHilo 
# ----------------------------------------
