# Dynamo graph excepciones_definidas_por_el_usuario_en_py.dyn (Dynamo 2.0.2.6826)

errores_con_types = Python()  # unwired: IN[0]
# ---------- errores_con_types.python (18 lines) ----------
# Activar la compatibilidad con Python y cargar biblioteca de DesignScript
import clr
clr.AddReference('ProtoGeometry')
from Autodesk.DesignScript.Geometry import *
#python tiene manejo avanzado de exvcepciones, ver en la doc de https://docs.python.org/3/library/exceptions.html

class Err(Exception): #heredamos la clase excption de python ya definida
	def __init__(self,valor):
		return "fue el error por"  + valor



try:
	raise Err("4")
except Err:
	ERROR="error escrito:"
	
OUT = ERROR
# ----------------------------------------
