# Dynamo graph que_es_una_excepcion_en_py.dyn (Dynamo 2.0.2.6826)

index_out_range = Python()  # unwired: IN[0]
# ---------- index_out_range.python (17 lines) ----------
# Activar la compatibilidad con Python y cargar biblioteca de DesignScript
import clr
clr.AddReference('ProtoGeometry')
from Autodesk.DesignScript.Geometry import *
#python tiene manejo avanzado de exvcepciones, ver en la doc de https://docs.python.org/3/library/exceptions.html
lista =[2,4]
 
try:
	a=lista[12]
except IndexError:
	a="error: error en el indice"
else:
	a = "no hay error"
finally: #finally es una seguridad que se ejecute si o si
	a= a  + " se ejecuto"

OUT = [a]
# ----------------------------------------
