# Dynamo graph 1.dyn (Dynamo 2.0.2.6826)

code_block = CodeBlock { [0..10..1]; }
file_path = Filename(".\functools.py")
readText = FileSystem.ReadText(file=file_path)
python_script = Python(IN[0]=code_block, IN[1]=readText)
# ---------- python_script.python (13 lines) ----------
# Activar la compatibilidad con Python y cargar biblioteca de DesignScript
import clr
clr.AddReference('ProtoGeometry')
from Autodesk.DesignScript.Geometry import *
# Las entradas de este nodo se almacenan como lista en las variables IN.
path = IN[1]
lista = IN[0]
from path import*
def suma(x,y):
	return x+y
	
sumar= reduce(suma,lista)
OUT = sumar
# ----------------------------------------
